# Grasshopper definition The 2 v1 and v2.gh (Grasshopper 0.9.75)

number_slider = Slider(-1.1, range=-20..20)  # disabled
number_slider_2 = Slider(1.8, range=-20..20)  # disabled
number_slider_3 = Slider(-20, range=-20..20)  # disabled
number_slider_4 = Slider(0, range=-20..20)  # disabled
number_slider_5 = Slider(1.1, range=-20..20)  # disabled
number_slider_6 = Slider(-9.7, range=-20..20)  # disabled
number_slider_7 = Slider(0, range=-20..20)  # disabled
number_slider_8 = Slider(-2.2, range=-20..20)  # disabled
number_slider_9 = Slider(-4.2, range=-20..20)  # disabled
number_slider_10 = Slider(-17.2, range=-20..20)  # disabled
construct_point = ConstructPoint(XCoordinate=number_slider, YCoordinate=number_slider_6, ZCoordinate=0)  # disabled
construct_point_2 = ConstructPoint(XCoordinate=number_slider_2, YCoordinate=number_slider_3, ZCoordinate=0)  # disabled
construct_point_3 = ConstructPoint(XCoordinate=number_slider_4, YCoordinate=number_slider_7, ZCoordinate=0)  # disabled
construct_point_4 = ConstructPoint(XCoordinate=number_slider_5, YCoordinate=number_slider_8, ZCoordinate=0)  # disabled
construct_point_5 = ConstructPoint(XCoordinate=number_slider_9, YCoordinate=number_slider_10, ZCoordinate=0)  # disabled
interpolate = Interpolate(
    Vertices=[construct_point_3, construct_point_4, construct_point, construct_point_5, construct_point_2],
    Degree=3,
    Periodic=False,
    KnotStyle=1)  # -> Curve, Length, Domain; disabled

number_slider_11 = Slider(-2.3, range=-20..20)  # disabled
number_slider_12 = Slider(-4.8, range=-20..20)  # disabled
number_slider_13 = Slider(-20, range=-20..20)  # disabled
number_slider_14 = Slider(-9.7, range=-20..20)  # disabled
number_slider_15 = Slider(-2, range=-20..20)  # disabled
number_slider_16 = Slider(0, range=-20..20)  # disabled
number_slider_17 = Slider(-0.9, range=-20..20)  # disabled
number_slider_18 = Slider(-2.2, range=-20..20)  # disabled
number_slider_19 = Slider(-6.2, range=-20..20)  # disabled
number_slider_20 = Slider(-18.9, range=-20..20)  # disabled
construct_point_6 = ConstructPoint(XCoordinate=number_slider_11, YCoordinate=number_slider_14, ZCoordinate=0)  # disabled
construct_point_7 = ConstructPoint(XCoordinate=number_slider_12, YCoordinate=number_slider_13, ZCoordinate=0)  # disabled
construct_point_8 = ConstructPoint(XCoordinate=number_slider_15, YCoordinate=number_slider_16, ZCoordinate=0)  # disabled
construct_point_9 = ConstructPoint(XCoordinate=number_slider_17, YCoordinate=number_slider_18, ZCoordinate=0)  # disabled
construct_point_10 = ConstructPoint(XCoordinate=number_slider_19, YCoordinate=number_slider_20, ZCoordinate=0)  # disabled
interpolate_2 = Interpolate(
    Vertices=[construct_point_8, construct_point_9, construct_point_6, construct_point_10, construct_point_7],
    Degree=3,
    Periodic=False,
    KnotStyle=1)  # -> Curve, Length, Domain; disabled

# ---- group: Left Neck
construct_point_11 = ConstructPoint(XCoordinate=Slider(-5.2, range=-20..20), YCoordinate=Slider(-20, range=-20..20), ZCoordinate=0)
construct_point_12 = ConstructPoint(XCoordinate=Slider(-6.2, range=-20..20), YCoordinate=Slider(-16.4, range=-20..20), ZCoordinate=0)
construct_point_13 = ConstructPoint(XCoordinate=Slider(-7.6, range=-20..20), YCoordinate=Slider(-20, range=-20..20), ZCoordinate=0)
construct_point_14 = ConstructPoint(XCoordinate=Slider(-0.8, range=-20..20), YCoordinate=Slider(-4.4, range=-20..20), ZCoordinate=0)
construct_point_15 = ConstructPoint(XCoordinate=Slider(-0.9, range=-20..20), YCoordinate=Slider(-8.2, range=-20..20), ZCoordinate=0)
construct_point_16 = ConstructPoint(XCoordinate=Slider(-3.5, range=-20..20), YCoordinate=Slider(-11.7, range=-20..20), ZCoordinate=0)
tail_length = Slider(7, range=0..10)
bottom_bulge = Slider(-0.07, range=-1..0)
vector_2pt = Vector2Pt(PointA=construct_point_12, PointB=construct_point_16, Unitize=False)  # -> Vector, Length
vector_2pt_2 = Vector2Pt(PointA=construct_point_14, PointB=construct_point_15, Unitize=False)  # -> Vector, Length
vector_2pt_3 = Vector2Pt(PointA=construct_point_11, PointB=construct_point_13, Unitize=False)  # -> Vector, Length
unit_x = UnitX(Factor=tail_length)
multiplication = Multiplication(A=vector_2pt.Vector, B=bottom_bulge)
move = Move(Geometry=construct_point_11, Motion=unit_x)  # -> Geometry, Transform
bezier_span = BezierSpan(
    StartPoint=construct_point_14,
    StartTangent=vector_2pt_2.Vector,
    EndPoint=construct_point_12,
    EndTangent=vector_2pt.Vector)  # -> Curve, Length, Domain
bezier_span_2 = BezierSpan(StartPoint=construct_point_12, StartTangent=multiplication, EndPoint=construct_point_11, EndTangent=vector_2pt_3.Vector)  # -> Curve, Length, Domain
line = Line(StartPoint=construct_point_11, EndPoint=move.Geometry)

# ---- group: Define Circles
circle_2_center_x = Slider(2, range=-20..20)
circle_2_center_y = Slider(-12, range=-20..20)
circle_4_center_x = Slider(-0.3, range=-20..20)
circle_4_center_y = Slider(-13, range=-20..20)
circle_3_center_x = Slider(-0.7, range=-20..20)
circle_3_center_y = Slider(0.68, range=-20..20)
vector_xyz = VectorXYZ(XComponent=circle_4_center_x, YComponent=circle_4_center_y, ZComponent=0)  # -> Vector, Length
vector_xyz_2 = VectorXYZ(XComponent=circle_3_center_x, YComponent=circle_3_center_y, ZComponent=0)  # -> Vector, Length
vector_xyz_3 = VectorXYZ(XComponent=circle_2_center_x, YComponent=circle_2_center_y, ZComponent=0)  # -> Vector, Length
construct_point_17 = ConstructPoint(XCoordinate=0, YCoordinate=0, ZCoordinate=0)
circle_1_raidus = Slider(5.8, range=0..10)
circle_2_radius = Slider(2.5, range=0..10)
circle_4_radius = Slider(2.1, range=0..10)
circle_3_radius = Slider(4, range=0..10)
move_2 = Move(Geometry=construct_point_17, Motion=vector_xyz.Vector)  # -> Geometry, Transform
move_3 = Move(Geometry=construct_point_17, Motion=vector_xyz_2.Vector)  # -> Geometry, Transform
move_4 = Move(Geometry=construct_point_17, Motion=vector_xyz_3.Vector)  # -> Geometry, Transform
circle_cnr = CircleCNR(Center=move_2.Geometry, Normal=Vector(0, 0, 1), Radius=circle_4_radius)
circle_cnr_2 = CircleCNR(Center=construct_point_17, Normal=Vector(0, 0, 1), Radius=circle_1_raidus)
circle_cnr_3 = CircleCNR(Center=move_3.Geometry, Normal=Vector(0, 0, 1), Radius=circle_3_radius)
circle_cnr_4 = CircleCNR(Center=move_4.Geometry, Normal=Vector(0, 0, 1), Radius=circle_2_radius)

# ----
head_position_along_circle = Slider(0.01, range=0.01..0.3)

# ---- group: Head
right_head_start = Slider(0.2, range=0..1)
evaluate_curve = EvaluateCurve(Curve=reparameterize(circle_cnr_2), Parameter=right_head_start)  # -> Point, Tangent, Angle
head_length = Slider(3, range=1..10)
line_sdl = LineSDL(Start=evaluate_curve.Point, Direction=evaluate_curve.Tangent, Length=head_length)
end_points = EndPoints(Curve=line_sdl)  # -> Start, End
tangent_lines = TangentLines(Point=end_points.End, Circle=circle_cnr_3)  # -> Tangent1, Tangent2
geometry = Geometry(tangent_lines.Tangent2)

# ---- group: Middle Curves
left_upper_end = Slider(0.11, range=0..1)
right_lower_end = Slider(0.6, range=0..1)
left_upper_end_2 = Slider(0, range=0..1)
left_lower_end = Slider(0.66, range=0..1)
evaluate_curve_2 = EvaluateCurve(Curve=reparameterize(circle_cnr_3), Parameter=left_upper_end_2)  # -> Point, Tangent, Angle
evaluate_curve_3 = EvaluateCurve(Curve=reparameterize(circle_cnr), Parameter=left_lower_end)  # -> Point, Tangent, Angle
evaluate_curve_4 = EvaluateCurve(Curve=reparameterize(circle_cnr_4), Parameter=right_lower_end)  # -> Point, Tangent, Angle
evaluate_curve_5 = EvaluateCurve(Curve=reparameterize(circle_cnr_2), Parameter=left_upper_end)  # -> Point, Tangent, Angle
right_upper_bezier_control = Slider(5, range=1..10)
right_lower_bezier_control = Slider(3, range=1..10)
left_lower_bezier_control = Slider(4, range=1..10)
rotate = Rotate(Geometry=evaluate_curve_4.Tangent, Angle=3.141592654, Plane=PlaneXY(0, 0, 0))  # -> Geometry, Transform
left_upper_bezier_control = Slider(4, range=1..10)
rotate_2 = Rotate(Geometry=evaluate_curve_3.Tangent, Angle=3.141592654, Plane=PlaneXY(0, 0, 0))  # -> Geometry, Transform
rotate_3 = Rotate(Geometry=evaluate_curve_5.Tangent, Angle=3.141592654, Plane=PlaneXY(0, 0, 0))  # -> Geometry, Transform
rotate_4 = Rotate(Geometry=evaluate_curve_2.Tangent, Angle=3.141592654, Plane=PlaneXY(0, 0, 0))  # -> Geometry, Transform
multiplication_2 = Multiplication(A=rotate.Geometry, B=right_lower_bezier_control)
multiplication_3 = Multiplication(A=rotate_2.Geometry, B=left_lower_bezier_control)
multiplication_4 = Multiplication(A=rotate_3.Geometry, B=right_upper_bezier_control)
multiplication_5 = Multiplication(A=rotate_4.Geometry, B=left_upper_bezier_control)
bezier_span_3 = BezierSpan(
    StartPoint=evaluate_curve_5.Point,
    StartTangent=multiplication_4,
    EndPoint=evaluate_curve_4.Point,
    EndTangent=multiplication_2)  # -> Curve, Length, Domain
bezier_span_4 = BezierSpan(
    StartPoint=evaluate_curve_2.Point,
    StartTangent=multiplication_5,
    EndPoint=evaluate_curve_3.Point,
    EndTangent=multiplication_3)  # -> Curve, Length, Domain

# ---- group: Tail
evaluate_curve_6 = EvaluateCurve(Curve=reparameterize(circle_cnr), Parameter=0.75)  # -> Point, Tangent, Angle
tail_length_2 = Slider(6, range=1..10)
line_sdl_2 = LineSDL(Start=evaluate_curve_6.Point, Direction=evaluate_curve_6.Tangent, Length=tail_length_2)
end_points_2 = EndPoints(Curve=line_sdl_2)  # -> Start, End
tangent_lines_2 = TangentLines(Point=end_points_2.End, Circle=circle_cnr_4)  # -> Tangent1, Tangent2
geometry_2 = Geometry(tangent_lines_2.Tangent2)

# ---- group: Bottom Left Arc
arc_sed = ArcSED(Start=evaluate_curve_3.Point, End=end_points_2.Start, Direction=evaluate_curve_3.Tangent)  # -> Arc, Plane, Radius

# ---- group: Bottom Right Arc
end_points_3 = EndPoints(Curve=geometry_2)  # -> Start, End
arc_sed_2 = ArcSED(Start=end_points_3.End, End=evaluate_curve_4.Point, Direction=tangent_lines_2.Tangent2)  # -> Arc, Plane, Radius

# ---- group: Top Right Arc
rotate_5 = Rotate(Geometry=line_sdl, Angle=3.141592654, Plane=PlaneXY(0, 0, 0))  # -> Geometry, Transform
arc_sed_3 = ArcSED(Start=end_points.Start, End=evaluate_curve_5.Point, Direction=rotate_5.Geometry)  # -> Arc, Plane, Radius

# ---- group: Top Left Arc
end_points_4 = EndPoints(Curve=tangent_lines.Tangent2)  # -> Start, End
arc_sed_4 = ArcSED(Start=evaluate_curve_2.Point, End=end_points_4.End, Direction=evaluate_curve_2.Tangent)  # -> Arc, Plane, Radius

# ---- group: Outside Curves
left_curve = Geometry([bezier_span_4.Curve, geometry, line_sdl_2, arc_sed.Arc, arc_sed_4.Arc])
right_curve = Geometry([arc_sed_3.Arc, bezier_span_3.Curve, arc_sed_2.Arc, geometry_2, line_sdl])

# ----
cutout_offset = Slider(0.5, range=-5..5)
multiplication_6 = Multiplication(A=cutout_offset, B=-1)

# ---- group: Create Offets
cutout_offset_2 = Slider(0.4, range=0..10)
join_curves = JoinCurves(Curves=[bezier_span_4.Curve, arc_sed.Arc], Preserve=False)
join_curves_2 = JoinCurves(Curves=[bezier_span_3.Curve, arc_sed_2.Arc], Preserve=False)
flip_curve = FlipCurve(Curve=join_curves)  # -> Curve, Flag
offset = Offset(Curve=join_curves_2, Distance=cutout_offset_2, Plane=PlaneXY(0, 0, 0), Corners=1)
offset_2 = Offset(Curve=flip_curve.Curve, Distance=cutout_offset_2, Plane=PlaneXY(0, 0, 0), Corners=1)

# ---- group: Top and Bottom of Lower Cutout
lower_cutout_tail_right = Slider(0.68, range=0..1)
lower_cutout_head_right = Slider(0.29, range=0..1)
lower_cutout_tail_left = Slider(0.14, range=0..1)
lower_cutout_head_left = Slider(0.67, range=0..1)
lower_cutout_tail_left_bezier_control = Slider(0.7, range=0..10)
lower_cutout_tail_right_bezier_control = Slider(0.9, range=0..10)
evaluate_curve_7 = EvaluateCurve(Curve=reparameterize(offset), Parameter=lower_cutout_head_right)  # -> Point, Tangent, Angle
evaluate_curve_8 = EvaluateCurve(Curve=reparameterize(offset), Parameter=lower_cutout_tail_right)  # -> Point, Tangent, Angle
lower_cutout_head_left_bezier_control = Slider(1.2, range=0..10)
evaluate_curve_9 = EvaluateCurve(Curve=reparameterize(offset_2), Parameter=lower_cutout_tail_left)  # -> Point, Tangent, Angle
lower_cutout_head_right_bezier_control = Slider(3.5, range=0..10)
evaluate_curve_10 = EvaluateCurve(Curve=reparameterize(offset_2), Parameter=lower_cutout_head_left)  # -> Point, Tangent, Angle
rotate_6 = Rotate(Geometry=evaluate_curve_9.Tangent, Angle=3.141592654, Plane=PlaneXY(0, 0, 0))  # -> Geometry, Transform
multiplication_7 = Multiplication(A=rotate_6.Geometry, B=lower_cutout_tail_left_bezier_control)
multiplication_8 = Multiplication(A=evaluate_curve_8.Tangent, B=lower_cutout_tail_right_bezier_control)
rotate_7 = Rotate(Geometry=evaluate_curve_7.Tangent, Angle=3.141592654, Plane=PlaneXY(0, 0, 0))  # -> Geometry, Transform
multiplication_9 = Multiplication(A=evaluate_curve_10.Tangent, B=lower_cutout_head_left_bezier_control)
multiplication_10 = Multiplication(A=rotate_7.Geometry, B=lower_cutout_head_right_bezier_control)
bezier_span_5 = BezierSpan(
    StartPoint=evaluate_curve_7.Point,
    StartTangent=multiplication_10,
    EndPoint=evaluate_curve_10.Point,
    EndTangent=multiplication_9)  # -> Curve, Length, Domain
bezier_span_6 = BezierSpan(
    StartPoint=evaluate_curve_8.Point,
    StartTangent=multiplication_8,
    EndPoint=evaluate_curve_9.Point,
    EndTangent=multiplication_7)  # -> Curve, Length, Domain

upper_cutout_tail_right = Slider(0.1, range=0..1)
upper_cutout_tail_left = Slider(0.98, range=0..1)
upper_cutout_head_right = Slider(0.03, range=0..1)
upper_cutout_head_left = Slider(1, range=0..1)
upper_cutout_tail_left_bezier_control = Slider(1.3, range=0..10)
upper_cutout_tail_right_bezier_control = Slider(0.4, range=0..10)
evaluate_curve_11 = EvaluateCurve(Curve=reparameterize(offset), Parameter=upper_cutout_head_right)  # -> Point, Tangent, Angle
evaluate_curve_12 = EvaluateCurve(Curve=reparameterize(offset), Parameter=upper_cutout_tail_right)  # -> Point, Tangent, Angle
evaluate_curve_13 = EvaluateCurve(Curve=reparameterize(offset_2), Parameter=upper_cutout_tail_left)  # -> Point, Tangent, Angle
upper_cutout_head_left_bezier_control = Slider(3.1, range=0..10)
upper_cutout_head_right_bezier_control = Slider(1, range=0..10)
evaluate_curve_14 = EvaluateCurve(Curve=reparameterize(offset_2), Parameter=upper_cutout_head_left)  # -> Point, Tangent, Angle
rotate_8 = Rotate(Geometry=evaluate_curve_13.Tangent, Angle=3.141592654, Plane=PlaneXY(0, 0, 0))  # -> Geometry, Transform
multiplication_11 = Multiplication(A=rotate_8.Geometry, B=upper_cutout_tail_left_bezier_control)
rotate_9 = Rotate(Geometry=evaluate_curve_11.Tangent, Angle=3.141592654, Plane=PlaneXY(0, 0, 0))  # -> Geometry, Transform
multiplication_12 = Multiplication(A=evaluate_curve_12.Tangent, B=upper_cutout_tail_right_bezier_control)
multiplication_13 = Multiplication(A=evaluate_curve_14.Tangent, B=upper_cutout_head_left_bezier_control)
multiplication_14 = Multiplication(A=rotate_9.Geometry, B=upper_cutout_head_right_bezier_control)
bezier_span_7 = BezierSpan(
    StartPoint=evaluate_curve_11.Point,
    StartTangent=multiplication_14,
    EndPoint=evaluate_curve_14.Point,
    EndTangent=multiplication_13)  # -> Curve, Length, Domain
bezier_span_8 = BezierSpan(
    StartPoint=evaluate_curve_12.Point,
    StartTangent=multiplication_12,
    EndPoint=evaluate_curve_13.Point,
    EndTangent=multiplication_11)  # -> Curve, Length, Domain

# ---- group: Left of Lower Cutout
construct_domain = ConstructDomain(DomainStart=lower_cutout_head_left, DomainEnd=lower_cutout_tail_left)
sub_curve = SubCurve(BaseCurve=reparameterize(offset_2), Domain=construct_domain)

construct_domain_2 = ConstructDomain(DomainStart=upper_cutout_head_left, DomainEnd=upper_cutout_tail_left)
sub_curve_2 = SubCurve(BaseCurve=reparameterize(offset_2), Domain=construct_domain_2)

# ---- group: Right of Lower Cutout
construct_domain_3 = ConstructDomain(DomainStart=lower_cutout_head_right, DomainEnd=lower_cutout_tail_right)
sub_curve_3 = SubCurve(BaseCurve=reparameterize(offset), Domain=construct_domain_3)

construct_domain_4 = ConstructDomain(DomainStart=upper_cutout_head_right, DomainEnd=upper_cutout_tail_right)
sub_curve_4 = SubCurve(BaseCurve=reparameterize(offset), Domain=construct_domain_4)

# ----
lower_cutout = Geometry([bezier_span_5.Curve, bezier_span_6.Curve, sub_curve_3, sub_curve])
lower_cutout_2 = Geometry([bezier_span_7.Curve, bezier_span_8.Curve, sub_curve_4, sub_curve_2])

# ---- group: Right Neck
neck_start_along_circle = Slider(0, range=0..1)
construct_point_18 = ConstructPoint(XCoordinate=Slider(-4.6, range=-20..20), YCoordinate=Slider(-17.3, range=-20..20), ZCoordinate=0)
construct_point_19 = ConstructPoint(XCoordinate=Slider(-3.1, range=-20..20), YCoordinate=Slider(-11.3, range=-20..20), ZCoordinate=0)
construct_point_20 = ConstructPoint(XCoordinate=Slider(-3, range=-20..20), YCoordinate=Slider(-19.3, range=-20..20), ZCoordinate=0)
bottom_scoop = Slider(-0.24, range=-1..0)
vector_2pt_4 = Vector2Pt(PointA=construct_point_18, PointB=construct_point_19, Unitize=False)  # -> Vector, Length
vector_2pt_5 = Vector2Pt(PointA=move.Geometry, PointB=construct_point_20, Unitize=False)  # -> Vector, Length
multiplication_15 = Multiplication(A=vector_2pt_4.Vector, B=bottom_scoop)
bezier_span_9 = BezierSpan(StartPoint=construct_point_18, StartTangent=multiplication_15, EndPoint=move.Geometry, EndTangent=vector_2pt_5.Vector)  # -> Curve, Length, Domain

# ---- group: Head
construct_point_21 = ConstructPoint(XCoordinate=Slider(-4, range=-20..20), YCoordinate=Slider(-4.5, range=-20..20), ZCoordinate=0)
circle_cnr_5 = CircleCNR(Center=construct_point_21, Normal=Vector(0, 0, 1), Radius=Slider(5, range=0..20))
evaluate_curve_15 = EvaluateCurve(Curve=reparameterize(circle_cnr_5), Parameter=head_position_along_circle)  # -> Point, Tangent, Angle
reverse = Reverse(Vector=evaluate_curve_15.Tangent)
head_length_2 = Slider(10, range=0..10)

# ---- group: Right Neck (continued)
evaluate_curve_16 = EvaluateCurve(Curve=reparameterize(circle_cnr_5), Parameter=neck_start_along_circle)  # -> Point, Tangent, Angle
reverse_2 = Reverse(Vector=evaluate_curve_16.Tangent)
multiplication_16 = Multiplication(A=reverse_2, B=Slider(1.5, range=0..10))
bezier_span_10 = BezierSpan(
    StartPoint=evaluate_curve_16.Point,
    StartTangent=multiplication_16,
    EndPoint=construct_point_18,
    EndTangent=vector_2pt_4.Vector)  # -> Curve, Length, Domain

# ---- group: Head (continued)
arc_sed_5 = ArcSED(Start=evaluate_curve_15.Point, End=evaluate_curve_16.Point, Direction=reverse)  # -> Arc, Plane, Radius
length = Length(Curve=arc_sed_5.Arc)
subtraction = Subtraction(A=head_length_2, B=length)
line_sdl_3 = LineSDL(Start=evaluate_curve_15.Point, Direction=evaluate_curve_15.Tangent, Length=subtraction)

# ---- group: Head Reconnect
end_points_5 = EndPoints(Curve=line_sdl_3)  # -> Start, End
reverse_3 = Reverse(Vector=vector_2pt_2.Vector)
construct_point_22 = ConstructPoint(XCoordinate=Slider(-0.5, range=-20..20), YCoordinate=Slider(-0.2, range=-20..20), ZCoordinate=0)
bezier_span_11 = BezierSpan(StartPoint=construct_point_14, StartTangent=reverse_3, EndPoint=end_points_5.End, EndTangent=construct_point_22)  # -> Curve, Length, Domain

# ----
join_curves_3 = JoinCurves(Curves=reparameterize([bezier_span_9.Curve, bezier_span_10.Curve, arc_sed_5.Arc, line_sdl_3]), Preserve=False)
join_curves_4 = JoinCurves(Curves=[line, bezier_span_2.Curve, bezier_span.Curve, bezier_span_11.Curve], Preserve=False)
offset_3 = Offset(Curve=join_curves_4, Distance=multiplication_6, Plane=PlaneXY(0, 0, 0), Corners=1)
offset_4 = Offset(Curve=join_curves_3, Distance=cutout_offset, Plane=PlaneXY(0, 0, 0), Corners=1)

# ---- group: Lower Cutout
number_slider_21 = Slider(0.72, range=0..1)
number_slider_22 = Slider(0.81, range=0..1)
evaluate_curve_17 = EvaluateCurve(Curve=reparameterize(offset_4), Parameter=number_slider_21)  # -> Point, Tangent, Angle
evaluate_curve_18 = EvaluateCurve(Curve=reparameterize(offset_4), Parameter=number_slider_22)  # -> Point, Tangent, Angle
circle_tantan = CircleTanTan(CurveA=offset_3, CurveB=offset_4, Point=evaluate_curve_17.Point)
circle_tantan_2 = CircleTanTan(CurveA=offset_3, CurveB=offset_4, Point=evaluate_curve_18.Point)
curve_curve = CurveCurve(CurveA=reparameterize(offset_3), CurveB=reparameterize(circle_tantan_2))  # -> Points, ParamsA, ParamsB
curve_curve_2 = CurveCurve(CurveA=reparameterize(offset_3), CurveB=reparameterize(circle_tantan))  # -> Points, ParamsA, ParamsB
construct_domain_5 = ConstructDomain(DomainStart=number_slider_21, DomainEnd=number_slider_22)
construct_domain_6 = ConstructDomain(DomainStart=curve_curve_2.ParamsA, DomainEnd=curve_curve.ParamsA)
evaluate_curve_19 = EvaluateCurve(Curve=reparameterize(circle_tantan_2), Parameter=curve_curve.ParamsB)  # -> Point, Tangent, Angle
evaluate_curve_20 = EvaluateCurve(Curve=reparameterize(circle_tantan), Parameter=curve_curve_2.ParamsB)  # -> Point, Tangent, Angle
reverse_4 = Reverse(Vector=evaluate_curve_19.Tangent)
sub_curve_5 = SubCurve(BaseCurve=reparameterize(offset_4), Domain=construct_domain_5)
sub_curve_6 = SubCurve(BaseCurve=reparameterize(offset_3), Domain=construct_domain_6)
arc_sed_6 = ArcSED(Start=curve_curve.Points, End=evaluate_curve_18.Point, Direction=reverse_4)  # -> Arc, Plane, Radius
arc_sed_7 = ArcSED(Start=curve_curve_2.Points, End=evaluate_curve_17.Point, Direction=evaluate_curve_20.Tangent)  # -> Arc, Plane, Radius

number_slider_23 = Slider(0.38, range=0..1)
number_slider_24 = Slider(0.55, range=0..1)
evaluate_curve_21 = EvaluateCurve(Curve=reparameterize(offset_4), Parameter=number_slider_23)  # -> Point, Tangent, Angle
evaluate_curve_22 = EvaluateCurve(Curve=reparameterize(offset_4), Parameter=number_slider_24)  # -> Point, Tangent, Angle
circle_tantan_3 = CircleTanTan(CurveA=offset_3, CurveB=offset_4, Point=evaluate_curve_21.Point)
circle_tantan_4 = CircleTanTan(CurveA=offset_3, CurveB=offset_4, Point=evaluate_curve_22.Point)
curve_curve_3 = CurveCurve(CurveA=reparameterize(offset_3), CurveB=reparameterize(circle_tantan_4))  # -> Points, ParamsA, ParamsB
curve_curve_4 = CurveCurve(CurveA=reparameterize(offset_3), CurveB=reparameterize(circle_tantan_3))  # -> Points, ParamsA, ParamsB
construct_domain_7 = ConstructDomain(DomainStart=number_slider_23, DomainEnd=number_slider_24)
construct_domain_8 = ConstructDomain(DomainStart=curve_curve_4.ParamsA, DomainEnd=curve_curve_3.ParamsA)
evaluate_curve_23 = EvaluateCurve(Curve=reparameterize(circle_tantan_4), Parameter=curve_curve_3.ParamsB)  # -> Point, Tangent, Angle
evaluate_curve_24 = EvaluateCurve(Curve=reparameterize(circle_tantan_3), Parameter=curve_curve_4.ParamsB)  # -> Point, Tangent, Angle
reverse_5 = Reverse(Vector=evaluate_curve_23.Tangent)
sub_curve_7 = SubCurve(BaseCurve=reparameterize(offset_4), Domain=construct_domain_7)
sub_curve_8 = SubCurve(BaseCurve=reparameterize(offset_3), Domain=construct_domain_8)
arc_sed_8 = ArcSED(Start=curve_curve_3.Points, End=evaluate_curve_22.Point, Direction=reverse_5)  # -> Arc, Plane, Radius
arc_sed_9 = ArcSED(Start=curve_curve_4.Points, End=evaluate_curve_21.Point, Direction=evaluate_curve_24.Tangent)  # -> Arc, Plane, Radius

# ----
circle_cnr_6 = CircleCNR(
    Center=[curve_curve_2.Points, curve_curve.Points, curve_curve_3.Points, curve_curve_4.Points],
    Normal=Vector(0, 0, 1),
    Radius=0.15)
join_curves_5 = JoinCurves(Curves=[arc_sed_9.Arc, sub_curve_8, sub_curve_7, arc_sed_8.Arc], Preserve=False)
geometry_3 = Geometry([join_curves_5, bezier_span_11.Curve, line_sdl_3, arc_sed_5.Arc])
join_curves_6 = JoinCurves(Curves=[arc_sed_7.Arc, sub_curve_6, sub_curve_5, arc_sed_6.Arc], Preserve=False)
