# Grasshopper definition The 2 v3.ghx (Grasshopper 0.9.76)

height_of_light = Slider(8, range=5..12)
top_of_neck = Slider(-0.24, range=-0.5..0)
plane = Plane(PlaneXY(13, 0, 0))
skin_width = Slider(3, range=0..20)
vector_xyz = VectorXYZ(XComponent=Slider(5, range=1..20), YComponent=Slider(-3, range=-10..20), ZComponent=0)  # -> Vector, Length
temp_cut_width = Slider(3, range=0..10)
number_of_cuts_ft = Slider(8.95, range=0..50)

# ---- group: Belly Height
plane_2 = Plane(PlaneXY(0, 0, 0))

# ---- group: Neck
neck_radius = Slider(1.6, range=0..50)
# ToDo:
# -relate the tail length to the height and solar angle
# -convert the head location to solar angle control
construct_point = ConstructPoint(XCoordinate=0, YCoordinate=0, ZCoordinate=0)
top_of_body = Slider(0.09, range=0..1)
circle_cnr = CircleCNR(Center=construct_point, Normal=Vector(0, 0, 1), Radius=neck_radius)

# ----
flip_curve = FlipCurve(Curve=circle_cnr)  # -> Curve, Flag

# ---- group: Head
evaluate_curve = EvaluateCurve(Curve=reparameterize(flip_curve.Curve), Parameter=top_of_neck)  # -> Point, Tangent, Angle
length_of_head = Slider(3.6, range=0..50)
multiplication = Multiplication(A=length_of_head, B=-1)
line_sdl = LineSDL(Start=evaluate_curve.Point, Direction=evaluate_curve.Tangent, Length=multiplication)

# ---- group: Neck (continued)
evaluate_curve_2 = EvaluateCurve(Curve=reparameterize(flip_curve.Curve), Parameter=top_of_body)  # -> Point, Tangent, Angle
arc_sed = ArcSED(Start=evaluate_curve.Point, End=evaluate_curve_2.Point, Direction=evaluate_curve.Tangent)  # -> Arc, Plane, Radius

# ---- group: Head and Neck Height
end_points = EndPoints(Curve=line_sdl)  # -> Start, End
deconstruct = Deconstruct(Point=end_points.End)  # -> XComponent, YComponent, ZComponent
deconstruct_2 = Deconstruct(Point=evaluate_curve_2.Point)  # -> XComponent, YComponent, ZComponent
subtraction = Subtraction(A=deconstruct.YComponent, B=deconstruct_2.YComponent)

# ----
length = Length(Curve=line_sdl)

# ---- group: Generate Neck Cuts
length_2 = Length(Curve=arc_sed.Arc)
deconstruct_plane = DeconstructPlane(Plane=plane)  # -> Origin, XAxis, YAxis, ZAxis
line_sdl_2 = LineSDL(Start=deconstruct_plane.Origin, Direction=deconstruct_plane.YAxis, Length=temp_cut_width)
unit_x = UnitX(Factor=length)
line_sdl_3 = LineSDL(Start=deconstruct_plane.Origin, Direction=deconstruct_plane.XAxis, Length=length_2)
move = Move(Geometry=line_sdl_2, Motion=unit_x)  # -> Geometry, Transform
multiplication_2 = Multiplication(A=length_2, B=number_of_cuts_ft)
curve_array = CurveArray(Geometry=move.Geometry, Curve=line_sdl_3, Count=multiplication_2)  # -> Geometry, Transform

# ---- group: Belly Height (continued)
line_sdl_4 = LineSDL(Start=evaluate_curve_2.Point, Direction=evaluate_curve_2.Tangent, Length=50)
end_points_2 = EndPoints(Curve=line_sdl_4)  # -> Start, End
plane_origin = PlaneOrigin(Base=plane_2, Origin=end_points_2.End)
rotate = Rotate(Geometry=line_sdl_4, Angle=4.71238898, Plane=plane_origin)  # -> Geometry, Transform
flip_curve_2 = FlipCurve(Curve=rotate.Geometry)  # -> Curve, Flag
deconstruct_3 = Deconstruct(Point=end_points_2.End)  # -> XComponent, YComponent, ZComponent

# ---- group: Belly
plane_3 = Plane(PlaneXY(0, 0, 0))
belly_radius = Slider(0.75, range=0..50)

# ---- group: Belly Height (continued)
evaluate_length = EvaluateLength(Curve=reparameterize(flip_curve_2.Curve), Length=belly_radius, Normalized=False)  # -> Point, Tangent, Parameter
circle_cnr_2 = CircleCNR(Center=evaluate_length.Point, Normal=Vector(0, 0, 1), Radius=belly_radius)
evaluate_curve_3 = EvaluateCurve(Curve=reparameterize(circle_cnr_2), Parameter=0.75)  # -> Point, Tangent, Angle
deconstruct_4 = Deconstruct(Point=evaluate_curve_3.Point)  # -> XComponent, YComponent, ZComponent
subtraction_2 = Subtraction(A=deconstruct_3.YComponent, B=deconstruct_4.YComponent)

# ----
addition = Addition(A=subtraction, B=subtraction_2)
angle = Angle(VectorA=Vector(0, -39, 0), VectorB=evaluate_curve_2.Tangent)  # -> Angle, Reflex
subtraction_3 = Subtraction(A=height_of_light, B=addition)
cosine = Cosine(Value=angle.Angle)
division = Division(A=subtraction_3, B=cosine)

# ---- group: Body
line_sdl_5 = LineSDL(Start=evaluate_curve_2.Point, Direction=evaluate_curve_2.Tangent, Length=division)

# ---- group: Belly (continued)
end_points_3 = EndPoints(Curve=line_sdl_5)  # -> Start, End
plane_origin_2 = PlaneOrigin(Base=plane_3, Origin=end_points_3.End)
rotate_2 = Rotate(Geometry=line_sdl_5, Angle=4.71238898, Plane=plane_origin_2)  # -> Geometry, Transform
flip_curve_3 = FlipCurve(Curve=rotate_2.Geometry)  # -> Curve, Flag
evaluate_length_2 = EvaluateLength(Curve=reparameterize(flip_curve_3.Curve), Length=belly_radius, Normalized=False)  # -> Point, Tangent, Parameter
circle_cnr_3 = CircleCNR(Center=evaluate_length_2.Point, Normal=Vector(0, 0, 1), Radius=belly_radius)
evaluate_curve_4 = EvaluateCurve(Curve=reparameterize(circle_cnr_3), Parameter=0.75)  # -> Point, Tangent, Angle
arc_sed_2 = ArcSED(Start=end_points_3.End, End=evaluate_curve_4.Point, Direction=line_sdl_5)  # -> Arc, Plane, Radius

# ---- group: Throat
average = Average(Input=[top_of_neck, top_of_body])
bottom_of_throat = Slider(0.49, range=0..1)
evaluate_curve_5 = EvaluateCurve(Curve=reparameterize(flip_curve.Curve), Parameter=average)  # -> Point, Tangent, Angle
evaluate_curve_6 = EvaluateCurve(Curve=reparameterize(line_sdl_5), Parameter=bottom_of_throat)  # -> Point, Tangent, Angle
end_points_4 = EndPoints(Curve=line_sdl)  # -> Start, End
line = Line(StartPoint=end_points_4.End, EndPoint=evaluate_curve_5.Point)
line_2 = Line(StartPoint=evaluate_curve_5.Point, EndPoint=evaluate_curve_6.Point)
join_curves = JoinCurves(Curves=[line, line_2], Preserve=False)
fillet = Fillet(Curve=join_curves, Radius=Slider(14.43, range=0..50))

# ---- group: Tail
tail_length = Slider(3.97, range=0..50)
line_sdl_6 = LineSDL(Start=evaluate_curve_4.Point, Direction=evaluate_curve_4.Tangent, Length=tail_length)

# ---- group: Back
top_of_back = Slider(0.36, range=0..1)
evaluate_curve_7 = EvaluateCurve(Curve=reparameterize(line_sdl_5), Parameter=top_of_back)  # -> Point, Tangent, Angle
end_points_5 = EndPoints(Curve=line_sdl_6)  # -> Start, End
geometry = Geometry(evaluate_length_2.Point)
line_3 = Line(StartPoint=evaluate_curve_7.Point, EndPoint=geometry)
line_4 = Line(StartPoint=geometry, EndPoint=end_points_5.End)
join_curves_2 = JoinCurves(Curves=[line_3, line_4], Preserve=False)
fillet_2 = Fillet(Curve=join_curves_2, Radius=Slider(2.55, range=0..50))

# ----
geometry_2 = Geometry([line_sdl, arc_sed.Arc, line_sdl_5, arc_sed_2.Arc, line_sdl_6, fillet, fillet_2])

# ---- group: Generate Skin
join_curves_3 = JoinCurves(Curves=reparameterize([line_sdl, arc_sed.Arc, line_sdl_5, arc_sed_2.Arc, line_sdl_6]), Preserve=False)
evaluate_curve_8 = EvaluateCurve(Curve=reparameterize(join_curves_3), Parameter=".5")  # -> Point, Tangent, Angle
shatter = Shatter(Curve=reparameterize(join_curves_3), Parameters=".5")
max_plywood_length = Slider(8, range=0..8)
length_3 = Length(Curve=shatter)
panel = Panel(length_3)
subtraction_4 = Subtraction(A=length_3, B=max_plywood_length)
maximum = Maximum(A=subtraction_4, B=0)

# ---- group: Top Skin
list_item = ListItem(List=length_3, Index=0, Wrap=True)
rectangle = Rectangle(Plane=plane, XSize=list_item, YSize=skin_width, Radius=0)  # -> Rectangle, Length

# ---- group: Middle Skin
list_item_2 = ListItem(List=maximum, Index=1, Wrap=True)
larger_than = LargerThan(FirstNumber=list_item_2, SecondNumber=0)  # -> LargerThan, OrEqualTo
dispatch = Dispatch(List=list_item_2, DispatchPattern=larger_than.LargerThan)  # -> ListA, ListB
multiplication_3 = Multiplication(A=dispatch.ListA, B=2)
unit_y = UnitY(Factor=skin_width)
rectangle_2 = Rectangle(Plane=plane, XSize=multiplication_3, YSize=skin_width, Radius=0)  # -> Rectangle, Length
multiplication_4 = Multiplication(A=unit_y, B=2)
move_2 = Move(Geometry=rectangle_2.Rectangle, Motion=multiplication_4)  # -> Geometry, Transform

# ---- group: Bottom Skin
list_item_3 = ListItem(List=length_3, Index=1, Wrap=True)
rectangle_3 = Rectangle(Plane=plane, XSize=list_item_3, YSize=skin_width, Radius=0)  # -> Rectangle, Length
unit_y_2 = UnitY(Factor=skin_width)
move_3 = Move(Geometry=rectangle_3.Rectangle, Motion=unit_y_2)  # -> Geometry, Transform

# ---- group: Generate Rib Cuts
deconstruct_plane_2 = DeconstructPlane(Plane=plane)  # -> Origin, XAxis, YAxis, ZAxis
unit_x_2 = UnitX(Factor=deconstruct_plane_2.Origin)
move_4 = Move(Geometry=geometry_2, Motion=unit_x_2)  # -> Geometry, Transform

# ----
rotate_3 = Rotate(Geometry=move_4.Geometry, Angle=1.570796327, Plane=PlaneXY(13.19313606, -2.710924228, 0))  # -> Geometry, Transform
move_5 = Move(Geometry=rotate_3.Geometry, Motion=vector_xyz.Vector)  # -> Geometry, Transform
length_4 = Length(Curve=line_sdl_6)

# ---- group: Generate Belly Cuts
length_5 = Length(Curve=arc_sed_2.Arc)
deconstruct_plane_3 = DeconstructPlane(Plane=plane)  # -> Origin, XAxis, YAxis, ZAxis
line_sdl_7 = LineSDL(Start=deconstruct_plane_3.Origin, Direction=deconstruct_plane_3.XAxis, Length=length_5)
line_sdl_8 = LineSDL(Start=deconstruct_plane_3.Origin, Direction=deconstruct_plane_3.YAxis, Length=temp_cut_width)
unit_x_3 = UnitX(Factor=length_4)
move_6 = Move(Geometry=line_sdl_8, Motion=unit_x_3)  # -> Geometry, Transform
multiplication_5 = Multiplication(A=length_5, B=number_of_cuts_ft)
curve_array_2 = CurveArray(Geometry=move_6.Geometry, Curve=line_sdl_7, Count=multiplication_5)  # -> Geometry, Transform
move_7 = Move(Geometry=curve_array_2.Geometry, Motion=unit_y_2)  # -> Geometry, Transform
