# Grasshopper definition The 2.gh (Grasshopper 0.9.76)

plane = Plane(Plane(origin=(-2.938192658, 0, 12), x=(0, 1, 0), y=(0.6018150232, 0, -0.79863551)))
rectangle = Rectangle(Plane=plane, XSize=Slider(2.5, range=0..10), YSize=Slider(3.6, range=0..10), Radius=0)  # -> Rectangle, Length
# Height and Solar Tilt Parameters
solar_tilt = Slider(37, range=0..140)
height_of_light = Slider(12, range=6..16)
boundary_surfaces = BoundarySurfaces(Edges=rectangle.Rectangle)
face_normals = FaceNormals(Mesh=boundary_surfaces)  # -> Centers, unitize(Normals)
multiplication = Multiplication(A=face_normals.Normals, B=Slider(-0.021, range=-1..1))
extrude = Extrude(Base=boundary_surfaces, Direction=multiplication)
skin_width = Slider(3, range=0..20)  # disabled
plane_2 = Plane(PlaneXY(13, 0, 0))  # disabled
# Cut Parameters
number_of_cuts_ft = Slider(8.95, range=0..50)  # disabled
temp_cut_width = Slider(3, range=0..10)  # disabled

# ----
# Belly Height
plane_3 = Plane(PlaneXY(0, 0, 0))

# ----
# Neck
neck_radius = Slider(1.6, range=0..50)
construct_point = ConstructPoint(XCoordinate=0, YCoordinate=0, ZCoordinate=0)
top_of_body = Slider(0.09, range=0..1)
circle_cnr = CircleCNR(Center=construct_point, Normal=Vector(0, 0, 1), Radius=neck_radius)
flip_curve = FlipCurve(Curve=circle_cnr)  # -> Curve, Flag
evaluate_curve = EvaluateCurve(Curve=reparameterize(flip_curve.Curve), Parameter=top_of_body)  # -> Point, Tangent, Angle

line_sdl = LineSDL(Start=evaluate_curve.Point, Direction=evaluate_curve.Tangent, Length=50)
end_points = EndPoints(Curve=line_sdl)  # -> Start, End
plane_origin = PlaneOrigin(Base=plane_3, Origin=end_points.End)
rotate = Rotate(Geometry=line_sdl, Angle=4.71238898, Plane=plane_origin)  # -> Geometry, Transform
flip_curve_2 = FlipCurve(Curve=rotate.Geometry)  # -> Curve, Flag
deconstruct = Deconstruct(Point=end_points.End)  # -> XComponent, YComponent, ZComponent

# ----
# Belly
plane_4 = Plane(PlaneXY(0, 0, 0))
belly_radius = Slider(0.75, range=0..50)

evaluate_length = EvaluateLength(Curve=reparameterize(flip_curve_2.Curve), Length=belly_radius, Normalized=False)  # -> Point, Tangent, Parameter
circle_cnr_2 = CircleCNR(Center=evaluate_length.Point, Normal=Vector(0, 0, 1), Radius=belly_radius)
evaluate_curve_2 = EvaluateCurve(Curve=reparameterize(circle_cnr_2), Parameter=0.75)  # -> Point, Tangent, Angle
deconstruct_2 = Deconstruct(Point=evaluate_curve_2.Point)  # -> XComponent, YComponent, ZComponent
subtraction = Subtraction(A=deconstruct.YComponent, B=deconstruct_2.YComponent)

# ----
# Head and Neck Height
deconstruct_3 = Deconstruct(Point=evaluate_curve.Point)  # -> XComponent, YComponent, ZComponent

# ----
# Head
length_of_head = Slider(3.6, range=0..50)
multiplication_2 = Multiplication(A=length_of_head, B=-1)

# ----
# Tail
tail_length = Slider(3.97, range=0..50)

# ---- group: Solar Tilt Diagram
circle_cnr_3 = CircleCNR(Center=construct_point, Normal=Vector(0, 0, 1), Radius=Slider(5, range=1..50))
pi = Pi(Factor=2)
radians = Radians(Degrees=solar_tilt)
division = Division(A=radians, B=pi)
evaluate_curve_3 = EvaluateCurve(Curve=reparameterize(circle_cnr_3), Parameter=division)  # -> Point, Tangent, Angle
subtraction_2 = Subtraction(A=1, B=division)
circle_cnr_4 = CircleCNR(Center=evaluate_curve_3.Point, Normal=Vector(0, 0, 1), Radius=Slider(0.7, range=0..10))

# ----
evaluate_curve_4 = EvaluateCurve(Curve=reparameterize(flip_curve.Curve), Parameter=subtraction_2)  # -> Point, Tangent, Angle
line_sdl_2 = LineSDL(Start=evaluate_curve_4.Point, Direction=unitize(evaluate_curve_4.Tangent), Length=multiplication_2)

arc_sed = ArcSED(Start=evaluate_curve_4.Point, End=evaluate_curve.Point, Direction=evaluate_curve_4.Tangent)  # -> Arc, Plane, Radius

end_points_2 = EndPoints(Curve=line_sdl_2)  # -> Start, End
deconstruct_4 = Deconstruct(Point=end_points_2.End)  # -> XComponent, YComponent, ZComponent
subtraction_3 = Subtraction(A=deconstruct_4.YComponent, B=deconstruct_3.YComponent)

# ----
# Body Length
addition = Addition(A=subtraction_3, B=subtraction)
angle = Angle(VectorA=Vector(0, -39, 0), VectorB=evaluate_curve.Tangent)  # -> Angle, Reflex
subtraction_4 = Subtraction(A=height_of_light, B=addition)
cosine = Cosine(Value=angle.Angle)
division_2 = Division(A=subtraction_4, B=cosine)

# ----
# Body
line_sdl_3 = LineSDL(Start=evaluate_curve.Point, Direction=evaluate_curve.Tangent, Length=division_2)

end_points_3 = EndPoints(Curve=line_sdl_3)  # -> Start, End
plane_origin_2 = PlaneOrigin(Base=plane_4, Origin=end_points_3.End)
rotate_2 = Rotate(Geometry=line_sdl_3, Angle=4.71238898, Plane=plane_origin_2)  # -> Geometry, Transform
flip_curve_3 = FlipCurve(Curve=rotate_2.Geometry)  # -> Curve, Flag
evaluate_length_2 = EvaluateLength(Curve=reparameterize(flip_curve_3.Curve), Length=belly_radius, Normalized=False)  # -> Point, Tangent, Parameter
circle_cnr_5 = CircleCNR(Center=evaluate_length_2.Point, Normal=Vector(0, 0, 1), Radius=belly_radius)
evaluate_curve_5 = EvaluateCurve(Curve=reparameterize(circle_cnr_5), Parameter=0.75)  # -> Point, Tangent, Angle
arc_sed_2 = ArcSED(Start=end_points_3.End, End=evaluate_curve_5.Point, Direction=line_sdl_3)  # -> Arc, Plane, Radius

line_sdl_4 = LineSDL(Start=evaluate_curve_5.Point, Direction=evaluate_curve_5.Tangent, Length=tail_length)

# ---- group: Height Diagram
end_points_4 = EndPoints(Curve=line_sdl_2)  # -> Start, End; disabled
end_points_5 = EndPoints(Curve=line_sdl_4)  # -> Start, End; disabled
deconstruct_5 = Deconstruct(Point=end_points_4.End)  # -> XComponent, YComponent, ZComponent; disabled
deconstruct_6 = Deconstruct(Point=end_points_5.End)  # -> XComponent, YComponent, ZComponent; disabled
construct_point_2 = ConstructPoint(XCoordinate=deconstruct_5.XComponent, YCoordinate=deconstruct_6.YComponent, ZCoordinate=0)  # disabled
number_slider = Slider(8.5, range=-10..10)  # disabled
line = Line(StartPoint=end_points_4.End, EndPoint=construct_point_2)  # disabled
unit_x = UnitX(Factor=number_slider)  # disabled
move = Move(Geometry=line, Motion=unit_x)  # -> Geometry, Transform; disabled
end_points_6 = EndPoints(Curve=move.Geometry)  # -> Start, End; disabled
number_slider_2 = Slider(0.2, range=0..1)  # disabled
unit_x_2 = UnitX(Factor=1)  # disabled
unit_x_3 = UnitX(Factor=1)  # disabled
line_sdl_5 = LineSDL(Start=end_points_6.Start, Direction=unit_x_2, Length=number_slider_2)  # disabled
line_sdl_6 = LineSDL(Start=end_points_6.End, Direction=unit_x_3, Length=number_slider_2)  # disabled
unit_x_4 = UnitX(Factor=-1)  # disabled
unit_x_5 = UnitX(Factor=-1)  # disabled
line_sdl_7 = LineSDL(Start=end_points_6.Start, Direction=unit_x_4, Length=number_slider_2)  # disabled
line_sdl_8 = LineSDL(Start=end_points_6.End, Direction=unit_x_5, Length=number_slider_2)  # disabled

# ----
# Back
top_of_back = Slider(0, range=0..1)
evaluate_curve_6 = EvaluateCurve(Curve=reparameterize(line_sdl_3), Parameter=top_of_back)  # -> Point, Tangent, Angle
end_points_7 = EndPoints(Curve=line_sdl_4)  # -> Start, End
geometry = Geometry(evaluate_length_2.Point)
line_2 = Line(StartPoint=evaluate_curve_6.Point, EndPoint=geometry)
line_3 = Line(StartPoint=geometry, EndPoint=end_points_7.End)
join_curves = JoinCurves(Curves=[line_2, line_3], Preserve=False)
fillet = Fillet(Curve=join_curves, Radius=Slider(2.55, range=0..50))

# ----
# Throat
average = Average(Input=[top_of_body, subtraction_2])
addition_2 = Addition(A=average, B=0.5)
bottom_of_throat = Slider(1, range=0..1)
evaluate_curve_7 = EvaluateCurve(Curve=reparameterize(flip_curve.Curve), Parameter=addition_2)  # -> Point, Tangent, Angle
evaluate_curve_8 = EvaluateCurve(Curve=reparameterize(line_sdl_3), Parameter=bottom_of_throat)  # -> Point, Tangent, Angle
end_points_8 = EndPoints(Curve=line_sdl_2)  # -> Start, End
line_4 = Line(StartPoint=end_points_8.End, EndPoint=evaluate_curve_7.Point)
line_5 = Line(StartPoint=evaluate_curve_7.Point, EndPoint=evaluate_curve_8.Point)
join_curves_2 = JoinCurves(Curves=[line_4, line_5], Preserve=False)
fillet_2 = Fillet(Curve=join_curves_2, Radius=Slider(14.43, range=0..50))

# ----
# Skin
join_curves_3 = JoinCurves(Curves=reparameterize([line_sdl_2, arc_sed.Arc, line_sdl_3, arc_sed_2.Arc, line_sdl_4]), Preserve=False)
evaluate_curve_9 = EvaluateCurve(Curve=reparameterize(join_curves_3), Parameter=".5")  # -> Point, Tangent, Angle
shatter = Shatter(Curve=reparameterize(join_curves_3), Parameters=".5")
max_plywood_length = Slider(8, range=0..8)
length = Length(Curve=shatter)
subtraction_5 = Subtraction(A=length, B=max_plywood_length)
maximum = Maximum(A=subtraction_5, B=0)

geometry_2 = Geometry([line_sdl_2, arc_sed.Arc, line_sdl_3, arc_sed_2.Arc, line_sdl_4, fillet_2, fillet])

# ---- group: Solar Tilt Diagram (continued)
line_6 = Line(StartPoint=evaluate_curve_3.Point, EndPoint=evaluate_curve_4.Point)
geometry_3 = Geometry([line_6, circle_cnr_4, evaluate_curve_4.Point, geometry_2])

# ---- group: Draw Lamp
unit_x_6 = UnitX(Factor=1)
geometry_4 = Geometry([arc_sed_2.Arc, line_sdl_4, fillet, arc_sed.Arc, line_sdl_2, fillet_2])
skin = Geometry(join_curves_3)
rotate_3d = Rotate3D(Geometry=skin, Angle=1.570796327, Center=Point(0, 0, 0), Axis=unit_x_6)  # -> Geometry, Transform
list_item = ListItem(List=flatten(rotate_3d.Geometry), Index=Slider(1, range=0..5), Wrap=True)
rotate_3d_2 = Rotate3D(Geometry=geometry_4, Angle=1.570796327, Center=Point(0, 0, 0), Axis=unit_x_6)  # -> Geometry, Transform
point = Point(Point(0, 0, 0))
end_points_9 = EndPoints(Curve=list_item)  # -> Start, End
subtraction_6 = Subtraction(A=point, B=end_points_9.End)
move_2 = Move(Geometry=rotate_3d_2.Geometry, Motion=subtraction_6)  # -> flatten(Geometry), Transform
move_3 = Move(Geometry=rotate_3d.Geometry, Motion=subtraction_6)  # -> flatten(Geometry), Transform
xz_plane = XZPlane(Origin=Point(0, 0, 0))
number_slider_3 = Slider(0.042, range=0..1)
offset = Offset(Curve=move_3.Geometry, Distance=number_slider_3, Plane=xz_plane, Corners=1)
boundary_surfaces_2 = BoundarySurfaces(Edges=move_2.Geometry)
end_points_10 = EndPoints(Curve=offset)  # -> Start, End
end_points_11 = EndPoints(Curve=move_3.Geometry)  # -> Start, End
line_7 = Line(StartPoint=end_points_10.End, EndPoint=end_points_11.End)
line_8 = Line(StartPoint=end_points_10.Start, EndPoint=end_points_11.Start)
width = Slider(2.5, range=0..4)
unit_y = UnitY(Factor=number_slider_3)
join_curves_4 = JoinCurves(Curves=[line_8, line_7, offset, move_3.Geometry], Preserve=False)
unit_y_2 = UnitY(Factor=width)
division_3 = Division(A=width, B=2)
boundary_surfaces_3 = BoundarySurfaces(Edges=join_curves_4)
extrude_2 = Extrude(Base=boundary_surfaces_2, Direction=unit_y)
unit_y_3 = UnitY(Factor=division_3)
extrude_3 = Extrude(Base=boundary_surfaces_3, Direction=unit_y_2)
move_4 = Move(Geometry=extrude_2, Motion=unit_y_3)  # -> Geometry, Transform

# ----
geometry_5 = Geometry([extrude_3, move_4.Geometry])
rotate_3 = Rotate(Geometry=geometry_5, Angle=3.141592654, Plane=PlaneXY(0, 0, 0))  # -> Geometry, Transform

# ----
# Bottom Skin Cuts
list_item_2 = ListItem(List=length, Index=1, Wrap=True)  # disabled
rectangle_2 = Rectangle(Plane=plane_2, XSize=list_item_2, YSize=skin_width, Radius=0)  # -> Rectangle, Length; disabled
unit_y_4 = UnitY(Factor=skin_width)  # disabled
move_5 = Move(Geometry=rectangle_2.Rectangle, Motion=unit_y_4)  # -> Geometry, Transform; disabled

# ----
# Middle Skin Cuts
list_item_3 = ListItem(List=maximum, Index=1, Wrap=True)  # disabled
larger_than = LargerThan(FirstNumber=list_item_3, SecondNumber=0)  # -> LargerThan, OrEqualTo; disabled
dispatch = Dispatch(List=list_item_3, DispatchPattern=larger_than.LargerThan)  # -> ListA, ListB; disabled
multiplication_3 = Multiplication(A=dispatch.ListA, B=2)  # disabled
unit_y_5 = UnitY(Factor=skin_width)  # disabled
rectangle_3 = Rectangle(Plane=plane_2, XSize=multiplication_3, YSize=skin_width, Radius=0)  # -> Rectangle, Length; disabled
multiplication_4 = Multiplication(A=unit_y_5, B=2)  # disabled
move_6 = Move(Geometry=rectangle_3.Rectangle, Motion=multiplication_4)  # -> Geometry, Transform; disabled

# ----
# Rib Cuts
deconstruct_plane = DeconstructPlane(Plane=plane_2)  # -> Origin, XAxis, YAxis, ZAxis; disabled
unit_x_7 = UnitX(Factor=deconstruct_plane.Origin)  # disabled
move_7 = Move(Geometry=geometry_2, Motion=unit_x_7)  # -> Geometry, Transform; disabled

# ----
# Top Skin Cuts
list_item_4 = ListItem(List=length, Index=0, Wrap=True)  # disabled
rectangle_4 = Rectangle(Plane=plane_2, XSize=list_item_4, YSize=skin_width, Radius=0)  # -> Rectangle, Length; disabled

# ----
# Belly Bend Cuts
length_2 = Length(Curve=line_sdl_4)  # disabled
length_3 = Length(Curve=arc_sed_2.Arc)  # disabled
deconstruct_plane_2 = DeconstructPlane(Plane=plane_2)  # -> Origin, XAxis, YAxis, ZAxis; disabled
line_sdl_9 = LineSDL(Start=deconstruct_plane_2.Origin, Direction=deconstruct_plane_2.XAxis, Length=length_3)  # disabled
line_sdl_10 = LineSDL(Start=deconstruct_plane_2.Origin, Direction=deconstruct_plane_2.YAxis, Length=temp_cut_width)  # disabled
unit_x_8 = UnitX(Factor=length_2)  # disabled
move_8 = Move(Geometry=line_sdl_10, Motion=unit_x_8)  # -> Geometry, Transform; disabled
multiplication_5 = Multiplication(A=length_3, B=number_of_cuts_ft)  # disabled
curve_array = CurveArray(Geometry=move_8.Geometry, Curve=line_sdl_9, Count=multiplication_5)  # -> Geometry, Transform; disabled
move_9 = Move(Geometry=curve_array.Geometry, Motion=unit_y_4)  # -> Geometry, Transform; disabled

# ----
# Neck Bend Cuts
length_4 = Length(Curve=arc_sed.Arc)  # disabled
deconstruct_plane_3 = DeconstructPlane(Plane=plane_2)  # -> Origin, XAxis, YAxis, ZAxis; disabled
length_5 = Length(Curve=line_sdl_2)  # disabled
line_sdl_11 = LineSDL(Start=deconstruct_plane_3.Origin, Direction=deconstruct_plane_3.YAxis, Length=temp_cut_width)  # disabled
unit_x_9 = UnitX(Factor=length_5)  # disabled
line_sdl_12 = LineSDL(Start=deconstruct_plane_3.Origin, Direction=deconstruct_plane_3.XAxis, Length=length_4)  # disabled
move_10 = Move(Geometry=line_sdl_11, Motion=unit_x_9)  # -> Geometry, Transform; disabled
multiplication_6 = Multiplication(A=length_4, B=number_of_cuts_ft)  # disabled
curve_array_2 = CurveArray(Geometry=move_10.Geometry, Curve=line_sdl_12, Count=multiplication_6)  # -> Geometry, Transform; disabled
